# Grasshopper definition MeshSimulation.gh (Grasshopper 1.0.7)
# plug-ins: MeshSimulation

number_slider = Slider(0.5, range=0..1)
number_slider_2 = Slider(50, range=0..100)
xy = XYPlane(Origin=Point(0, 0, 0))
pt = ConstructPoint(XCoordinate=number_slider, YCoordinate=number_slider, ZCoordinate=0)
move = Move(Geometry=xy, Motion=pt)  # -> Geometry, Transform
number_slider_3 = Slider(1, range=0..1)
sqgrid = Square(Plane=move.Geometry, Size=1, ExtentX=number_slider_2, ExtentY=number_slider_2)  # -> Cells, Points
image = ImageSampler(
    sqgrid.Points,
    FilePath="E:\大四下\课\venous\code\MeshSimulation\2Dmesh2.png",
    Filter="Colour",
    Interpolate=False,
    Umax=50,
    Umin=0,
    Vmax=50,
    Vmin=0,
    Wrap=1)
python = GhPythonScript(x=image)  # -> out, a
# ---------- python: Python ----------
__author__ = "YTY"
__version__ = "2020.05.12"

import rhinoscriptsyntax as rs
if(x[0]>250 and x[1]>250 and x[2]>250):
    a = 1
elif(x[2]>250):
    a = 2
else:
    a = 0
# ---------- end python ----------
panel = Panel(python.a)
pt_2 = Point(Point(26.5027479, 3.852584487, 0))
timer = Timer(TimerInterval=100, Target=meshsimulation)
panel_2 = Panel(pt_2)
meshsimulation = MeshSimulation(
    Reset=Toggle(True),
    Height=number_slider_2,
    Width=number_slider_2,
    Step=number_slider_3,
    VolumeMesh=python.a,
    LiquidSourcePointList=pt_2,
    LiquidSourcePressureList=Slider(0.3, range=0..10))
displaymesh = Ghc_DisplayMesh(Mesh=meshsimulation, Step=number_slider_3)
