# Grasshopper definition experiment.gh (Grasshopper 1.0.7)
# plug-ins: MeshSimulation, Human

# ----
# Option: Show / hide the grid display
number_slider = Slider(3.488, range=1..10)
pt = Point(Point(26.50073869, 3.56691514, 0))

number_slider_2 = Slider(1, range=0..1)
number_slider_3 = Slider(1, range=0..1)
pt_2 = ConstructPoint(XCoordinate=number_slider_2, YCoordinate=number_slider_2, ZCoordinate=0)
xy = XYPlane(Origin=Point(0, 0, 0))
move = Move(Geometry=xy, Motion=pt_2)  # -> Geometry, Transform

number_slider_4 = Slider(20, range=0..20)
sqgrid = Square(Plane=PlaneXY(0, 0, 0), Size=Slider(5, range=0..10), ExtentX=number_slider_4, ExtentY=number_slider_4)  # -> flatten(Cells), Points
previewlw = CustomPreviewLineweights(Geometry=sqgrid.Cells, Shader=ColourSwatch(SwatchColor=RGB(224, 224, 224)), Absolute=False)

# ----
# Step2: Turn on the toggle to initialize, and define the location of the fluid source.
# 
# Turn off the toggle to start the simulation, change the pressure slider to get fluid ditribution.
# 
# Turn on the toggle again to reset the fluid.
number_slider_5 = Slider(50, range=0..100)
number_slider_6 = Slider(50, range=0..100)

sqgrid_2 = Square(Plane=PlaneXY(0, 0, 0), Size=1, ExtentX=number_slider_6, ExtentY=number_slider_5)  # -> flatten(Cells), Points
previewlw_2 = CustomPreviewLineweights(Geometry=sqgrid_2.Cells, Shader=ColourSwatch(SwatchColor=RGB(161, 161, 161)), Absolute=False)

sqgrid_3 = Square(Plane=move.Geometry, Size=number_slider_3, ExtentX=number_slider_6, ExtentY=number_slider_5)  # -> Cells, Points

# ----
# Step1: Import the venous structure defination picture,
# and set the size of the canvas
image = ImageSampler(
    sqgrid_3.Points,
    FilePath="E:\大四下\课\venous\code\MeshSimulation\experiments\mesh2.png",
    Filter="Colour",
    Interpolate=False,
    Umax=50,
    Umin=1,
    Vmax=50,
    Vmin=1,
    Wrap=1)

python = GhPythonScript(x=image)  # -> out, a
# ---------- python: Python ----------
__author__ = "YTY"
__version__ = "2020.05.12"

import rhinoscriptsyntax as rs
if(x[0]>250 and x[1]>250 and x[2]>250):
    a = 1
elif(x[2]>250):
    a = 2
else:
    a = 0
# ---------- end python ----------
meshsimulation = MeshSimulation(
    Reset=Toggle(False),
    Height=number_slider_5,
    Width=number_slider_6,
    Step=number_slider_3,
    VolumeMesh=python.a,
    LiquidSourcePointList=pt,
    LiquidSourcePressureList=reverse(number_slider))  # -> Output, DisplayMesh
panel = Panel(meshsimulation.Output)
