# Grasshopper definition linear.gh (Grasshopper 1.0.7)
# plug-ins: MeshSimulation, Human

number_slider = Slider(0.5, range=0..1)
number_slider_2 = Slider(50, range=0..100)
number_slider_3 = Slider(1, range=0..1)
pt = ConstructPoint(XCoordinate=number_slider, YCoordinate=number_slider, ZCoordinate=0)
xy = XYPlane(Origin=Point(0, 0, 0))
number_slider_4 = Slider(10, range=0..10)
move = Move(Geometry=xy, Motion=pt)  # -> Geometry, Transform
sqgrid = Square(Plane=move.Geometry, Size=1, ExtentX=number_slider_2, ExtentY=number_slider_2)  # -> Cells, Points
sqgrid_2 = Square(Plane=PlaneXY(0, 0, 0), Size=1, ExtentX=number_slider_2, ExtentY=number_slider_2)  # -> flatten(Cells), Points
sqgrid_3 = Square(Plane=PlaneXY(0, 0, 0), Size=Slider(5, range=0..10), ExtentX=number_slider_4, ExtentY=number_slider_4)  # -> flatten(Cells), Points
image = ImageSampler(
    sqgrid.Points,
    FilePath="E:\大四下\课\venous\code\MeshSimulation\experiments\linear.png",
    Filter="Colour",
    Interpolate=False,
    Umax=50,
    Umin=0,
    Vmax=50,
    Vmin=0,
    Wrap=1)
previewlw = CustomPreviewLineweights(Geometry=sqgrid_3.Cells, Shader=ColourSwatch(SwatchColor=RGB(224, 224, 224)), Absolute=False)
previewlw_2 = CustomPreviewLineweights(Geometry=sqgrid_2.Cells, Shader=ColourSwatch(SwatchColor=RGB(161, 161, 161)), Absolute=False)
python = GhPythonScript(x=image)  # -> out, a
# ---------- python: Python ----------
__author__ = "YTY"
__version__ = "2020.05.12"

import rhinoscriptsyntax as rs
if(x[0]>250 and x[1]>250 and x[2]>250):
    a = 1
elif(x[2]>250):
    a = 2
else:
    a = 0
# ---------- end python ----------
timer = Timer(TimerInterval=100, Target=meshsimulation)  # disabled
pt_2 = Point(Point(3.512002101, 8.631920854, 0))
pt_3 = Point(Point(3.512002101, 19.44089634, 0))
pt_4 = Point(Point(3.512002101, 27.38218445, 0))
pt_5 = Point(Point(3.512002101, 36.27936836, 0))
dup = DuplicateData(Data=Slider(3.064, range=0..10), Number=Slider(4, range=0..10), Order=True)
merge = Merge(Data1=pt_5, Data2=pt_4, Data3=pt_3, Data4=pt_2)
meshsimulation = MeshSimulation(
    Reset=Toggle(True),
    Height=number_slider_2,
    Width=number_slider_2,
    Step=number_slider_3,
    VolumeMesh=python.a,
    LiquidSourcePointList=merge,
    LiquidSourcePressureList=dup)  # -> Output, DisplayMesh
panel = Panel(meshsimulation.Output)
displaymesh = Ghc_DisplayMesh(Mesh=meshsimulation.DisplayMesh, Step=number_slider_3)
