# Grasshopper definition test.gh (Grasshopper 1.0.7)
# plug-ins: MeshSimulation

path = FilePath("E:\大四下\课\venous\code\MeshSimulation\experiments\mesh4.png")
cluster = Cluster(F=path)
pt = Point(Point(10.35584013, 2.519072812, 0))
meshsimulation3d = MeshSimulation3D(
    Reset=Toggle(True),
    Step=Slider(1, range=0..1),
    VesselCellList=cluster,
    LiquidSourcePointList=pt,
    LiquidSourcePressureList=Slider(1.973, range=0..10))  # -> Output, DisplayMesh
panel = Panel(meshsimulation3d.Output)

# ==== cluster Cluster
F = ClusterInput()
img = ImportImage(File=F)
demesh = DeconstructMesh(Mesh=img)  # -> Vertices, Faces, Colours, Normals
bnd = Bounds2D(Coordinates=demesh.Vertices)
dedom2 = DeconstructDomain²(Domain=bnd)  # -> UComponent, VComponent
dedomain = DeconstructDomain(Domain=dedom2.VComponent)  # -> Start, End
dedomain_2 = DeconstructDomain(Domain=dedom2.UComponent)  # -> Start, End
_2dimagemesh = _2DImageMesh(ColorList=demesh.Colours, Width=dedomain_2.End, Height=dedomain.End)
vesselcelllist = ClusterOutput(_2dimagemesh)
